# Dynamo graph UA-Material-Conversao.dyn (Dynamo 2.16.1.2727)

# group: LER MATERIAL DOS OBJETOS REVIT
categories = Categories("OST_Parts")
all_elements_of_category = ElementsOfCategory(Category=categories)
code_block = CodeBlock { "Material"; }
getParameterValueByName = Element.GetParameterValueByName(element=all_elements_of_category, parameterName=code_block)
name = Element.Name(element=getParameterValueByName)

code_block_2 = CodeBlock { "UA-Auxiliar"; }
file_path = Filename("..\Categoria de materiais.xlsx")
file_from_path = FileObject(path=file_path)
code_block_3 = CodeBlock { "Folha4"; }
boolean = BoolSelector(false)
importExcel = Data.ImportExcel(file=file_from_path, sheetName=code_block_3, showExcel=boolean)
transpose = List.Transpose(lists=importExcel)
code_block_4 = CodeBlock { 1; }
code_block_5 = CodeBlock(IN=transpose, nCol=code_block_4) { IN[nCol]; }
code_block_6 = CodeBlock { 0; }
code_block_7 = CodeBlock(IN=transpose, nCol=code_block_6) { IN[nCol]; }
indexOf = List.IndexOf(list=code_block_7, element=name)
getItemAtIndex = List.GetItemAtIndex(list=code_block_5, index=indexOf)
setParameterByName = Element.SetParameterByName(element=all_elements_of_category, parameterName=code_block_2, value=getItemAtIndex)
