# Dynamo graph UA-Material-ListUnique.dyn (Dynamo 2.16.1.2727)

file_path = Filename("..\Categoria de materiais.xlsx")
code_block = CodeBlock { "Folha4"; }
code_block_2 = CodeBlock { 0; }
categories = Categories("OST_Parts")
all_elements_of_category = ElementsOfCategory(Category=categories)
code_block_3 = CodeBlock { "Material"; }
getParameterValueByName = Element.GetParameterValueByName(element=all_elements_of_category, parameterName=code_block_3)
name = Element.Name(element=getParameterValueByName)
uniqueItems = List.UniqueItems(list=name)
transpose = List.Transpose(lists=uniqueItems)
exportToExcel = Data.ExportToExcel(filePath=file_path, sheetName=code_block, startRow=code_block_2, startColumn=code_block_2, data=transpose)
